# Grasshopper definition public_hops_definition_one.gh (Grasshopper 1.0.8)
# Description of public Hops definition one

crv = GetGeometry(AnnotationTypeFilter=3966, AtLeast=1, AtMost=1, DeleteInput=False, Filter=1074081855, TreeAccess=False)
num = GetNumber(AtLeast=1, AtMost=1, Maximum=1.797693135e+308, Minimum=-1.797693135e+308, TreeAccess=False)
str = GetString(AtLeast=1, AtMost=1, TreeAccess=False)
txt = Text(str)
crv_2 = Curve(crv)
sc = Number(num)
panel = Panel("v2")
log = Text("log")
br = Brep(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)
c_print = ContextPrint(Text=log)
c_bake = ContextBake(Content=br)
